# Grasshopper definition 210612_make-movie.gh (Grasshopper 1.0.7)
# plug-ins: horsterCameraControl

panel = Panel("ものを移動させる、戻す。")
panel_2 = Panel("テキストの追加")  # disabled
panel_3 = Panel("線を短くする動作を逆再生")  # disabled
panel_4 = Panel("線の色を変化させる")  # disabled
panel_5 = Panel("引き出し線を伸ばす")  # disabled
panel_6 = Panel("グラフマッパーで変化のスピードを調整")

# ---- group: 行きのスライダー
number_slider = Slider(0, range=0..1)

# ---- group: 戻りのスライダー
number_slider_2 = Slider(0, range=0..1)

# ----
panel_7 = Panel("カメラアングルの操作")
number_slider_3 = Slider(0, range=0..1)  # disabled
number_slider_4 = Slider(0, range=0..1)  # disabled
number_slider_5 = Slider(0, range=0..1)  # disabled

# ---- group: コート・フィールド
crv = Curve([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])  # disabled

# ----
number_slider_6 = Slider(0, range=0..1)  # disabled

# ---- group: コート・フィールド
crv_2 = Curve([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])  # disabled

# ----
number_slider_7 = Slider(0, range=0..1)  # disabled

# ---- group: コート・フィールド
crv_3 = Curve([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])  # disabled

# ----
number_slider_8 = Slider(0, range=0..1)  # disabled
number_slider_9 = Slider(0, range=0..1)  # disabled
number_slider_10 = Slider(0, range=0..1)  # disabled

# ---- group: コート・フィールド
crv_4 = Curve([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])  # disabled

# ----
number_slider_11 = Slider(0, range=0..1)  # disabled
number_slider_12 = Slider(0, range=0..1)  # disabled
number_slider_13 = Slider(0, range=0..1)  # disabled
number_slider_14 = Slider(0, range=0..1)  # disabled

# ---- group: コート・フィールド
crv_5 = Curve([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])

# ----
number_slider_15 = Slider(0, range=0..1)  # disabled
subtraction = Subtraction(A=number_slider, B=number_slider_2)

# ---- group: 長さ変化
explode = Explode(Curve=crv_2, Recursive=True)  # -> Segments, Vertices; disabled
crv_6 = Curve(explode.Segments)  # disabled
panel_8 = Panel("1")  # disabled
subtraction_2 = Subtraction(A=panel_8, B=number_slider_7)  # disabled
len = Length(Curve=crv_6)  # disabled
multiplication = Multiplication(A=len, B=subtraction_2)  # disabled
neg = Negative(Value=multiplication)  # disabled
panel_9 = Panel("0")  # disabled
ext = ExtendCurve(Curve=crv_6, Type=0, Start=panel_9, End=neg)  # disabled

explode_2 = Explode(Curve=crv_3, Recursive=True)  # -> Segments, Vertices; disabled
crv_7 = Curve(explode_2.Segments)  # disabled
panel_10 = Panel("1")  # disabled
subtraction_3 = Subtraction(A=panel_10, B=number_slider_8)  # disabled
len_2 = Length(Curve=crv_7)  # disabled
multiplication_2 = Multiplication(A=len_2, B=subtraction_3)  # disabled
neg_2 = Negative(Value=multiplication_2)  # disabled
panel_11 = Panel("0")  # disabled
ext_2 = ExtendCurve(Curve=crv_7, Type=0, Start=panel_11, End=neg_2)  # disabled

explode_3 = Explode(Curve=crv, Recursive=True)  # -> Segments, Vertices; disabled
crv_8 = Curve(explode_3.Segments)  # disabled
panel_12 = Panel("1")  # disabled
subtraction_4 = Subtraction(A=panel_12, B=number_slider_6)  # disabled
len_3 = Length(Curve=crv_8)  # disabled
multiplication_3 = Multiplication(A=len_3, B=subtraction_4)  # disabled
neg_3 = Negative(Value=multiplication_3)  # disabled
panel_13 = Panel("0")  # disabled
ext_3 = ExtendCurve(Curve=crv_8, Type=0, Start=panel_13, End=neg_3)  # disabled

explode_4 = Explode(Curve=crv_4, Recursive=True)  # -> Segments, Vertices; disabled
crv_9 = Curve(explode_4.Segments)  # disabled
panel_14 = Panel("1")  # disabled
subtraction_5 = Subtraction(A=panel_14, B=number_slider_11)  # disabled
len_4 = Length(Curve=crv_9)  # disabled
multiplication_4 = Multiplication(A=len_4, B=subtraction_5)  # disabled
neg_4 = Negative(Value=multiplication_4)  # disabled
panel_15 = Panel("0")  # disabled
ext_4 = ExtendCurve(Curve=crv_9, Type=0, Start=panel_15, End=neg_4)  # disabled

# ----
num = Number(subtraction)

number_slider_16 = Slider(2, range=0..10)  # disabled
item = ListItem(List=flatten(explode_3.Segments), Index=number_slider_16, Wrap=True)  # disabled
number_slider_17 = Slider(946, range=0..2000)  # disabled
number_slider_18 = Slider(2000, range=0..2000)  # disabled
end = EndPoints(Curve=item)  # -> Start, End; disabled
pt = Point(end.Start)  # disabled
pt_2 = PointOriented(BasePlane=pt, UComponent=number_slider_17, VComponent=number_slider_17, WComponent=0)  # disabled
pt_3 = PointOriented(BasePlane=pt_2, UComponent=number_slider_18, VComponent=0, WComponent=0)  # disabled
merge = Merge(Data1=pt, Data2=pt_2, Data3=pt_3)  # disabled
pline = PolyLine(Vertices=merge, Closed=False)  # disabled

number_slider_19 = Slider(2, range=0..10)  # disabled
item_2 = ListItem(List=flatten(explode_4.Segments), Index=number_slider_19, Wrap=True)  # disabled
number_slider_20 = Slider(2000, range=0..2000)  # disabled
number_slider_21 = Slider(946, range=0..2000)  # disabled
end_2 = EndPoints(Curve=item_2)  # -> Start, End; disabled
pt_4 = Point(end_2.Start)  # disabled
pt_5 = PointOriented(BasePlane=pt_4, UComponent=number_slider_21, VComponent=number_slider_21, WComponent=0)  # disabled
pt_6 = PointOriented(BasePlane=pt_5, UComponent=number_slider_20, VComponent=0, WComponent=0)  # disabled
merge_2 = Merge(Data1=pt_4, Data2=pt_5, Data3=pt_6)  # disabled
pline_2 = PolyLine(Vertices=merge_2, Closed=False)  # disabled

# ---- group: アングル出し
getcamera = GetCamera(GetCamera=Toggle(False))  # -> Location, Target, LensLength, UpDirection
ln = Line(StartPoint=getcamera.Location, EndPoint=getcamera.Target)

# ----
crv_10 = Curve([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])
number_slider_22 = Slider(100, range=0..100)
multiplication_5 = Multiplication(A=num, B=Slider(300, range=0..300))

# ---- group: カメラワーク
end_3 = EndPoints(Curve=crv_10)  # -> Start, End
intcrv = Interpolate(Vertices=end_3.End, Degree=3, Periodic=False, KnotStyle=1)  # -> Curve, Length, Domain
intcrv_2 = Interpolate(Vertices=end_3.Start, Degree=3, Periodic=False, KnotStyle=1)  # -> Curve, Length, Domain
num_2 = Number(Slider(1, range=0..1))
eval = EvaluateCurve(Curve=reparameterize(intcrv_2.Curve), Parameter=num_2)  # -> Point, Tangent, Angle
eval_2 = EvaluateCurve(Curve=reparameterize(intcrv.Curve), Parameter=num_2)  # -> Point, Tangent, Angle
setcam = SetCamera(CameraLocation=eval.Point, TargetLocation=eval_2.Point, Activate=Toggle(False))

# ----
subtraction_6 = Subtraction(A=Slider(1, range=0..1), B=Slider(0, range=0..1))
box = CenterBox(Base=PlaneXY(0, 0, 0), X=number_slider_22, Y=number_slider_22, Z=number_slider_22)
X = UnitX(Factor=multiplication_5)

# ---- group: 色変化
panel_16 = Panel("255")  # disabled
panel_17 = Panel("255")  # disabled
multiplication_6 = Multiplication(A=panel_17, B=number_slider_5)  # disabled
rgb = ColourRGB(Alpha=panel_16, Red=multiplication_6, Green=multiplication_6, Blue=multiplication_6)  # disabled
preview = CustomPreview(Geometry=ext_2, Material=rgb)  # disabled

# ----
move = Move(Geometry=box, Motion=X)  # -> Geometry, Transform

# ---- group: 色変化
panel_18 = Panel("255")  # disabled
panel_19 = Panel("255")  # disabled
multiplication_7 = Multiplication(A=panel_19, B=number_slider_3)  # disabled
rgb_2 = ColourRGB(Alpha=panel_18, Red=multiplication_7, Green=multiplication_7, Blue=multiplication_7)  # disabled
preview_2 = CustomPreview(Geometry=ext_3, Material=rgb_2)  # disabled

panel_20 = Panel("255")  # disabled
panel_21 = Panel("255")  # disabled
multiplication_8 = Multiplication(A=panel_21, B=number_slider_9)  # disabled
rgb_3 = ColourRGB(Alpha=panel_20, Red=multiplication_8, Green=multiplication_8, Blue=multiplication_8)  # disabled
preview_3 = CustomPreview(Geometry=ext_4, Material=rgb_3)  # disabled

# ----
num_3 = Number(subtraction_6)

# ---- group: 引き出し線
crv_11 = Curve(pline)  # disabled

crv_12 = Curve(pline_2)  # disabled

# ----
graph = GraphMapper(num_3, x0=0, x1=1, y0=0, y1=1, container_name="Bezier", cpx=[0, 0.8988665342, 0.09694417566, 1], cpy=[0, 0, 1, 1])
graph_2 = GraphMapper(num_3, x0=0, x1=1, y0=0, y1=1, container_name="Bezier", cpx=[0, 1, 0.6964199543, 1], cpy=[0, 0, 1, 1])
graph_3 = GraphMapper(
    num_3,
    x0=0,
    x1=1,
    y0=0,
    y1=1,
    container_name="Bezier",
    cpx=[0, 0.1586197615, 0.3991203904, 1],
    cpy=[0.1980617642, 0.8375757337, 1, 1])
graph_4 = GraphMapper(num_3, x0=0, x1=1, y0=0, y1=1, container_name="Bezier", cpx=[0, 0.4803864956, 0.4160810709, 1], cpy=[0, 0, 1, 1])
graph_5 = GraphMapper(num_3, x0=0, x1=1, y0=0, y1=1, container_name="Bezier", cpx=[0, 1, 0.7344528437, 1], cpy=[0, 0, 1, 1])
graph_6 = GraphMapper(num_3, x0=0, x1=1, y0=0, y1=1, container_name="Bezier", cpx=[0, 0, 0.1774327308, 1], cpy=[0, 1, 1, 1])

explode_5 = Explode(Curve=crv_11, Recursive=True)  # -> Segments, Vertices; disabled
item_3 = ListItem(List=explode_5.Segments, Index=0, Wrap=True)  # disabled
number_slider_23 = Slider(200, range=0..1000)  # disabled
end_4 = EndPoints(Curve=item_3)  # -> Start, End; disabled
pt_7 = Point(end_4.End)  # disabled
number_slider_24 = Slider(589, range=0..1000)  # disabled
panel_22 = Panel("255")  # disabled
panel_23 = Panel("255")  # disabled
multiplication_9 = Multiplication(A=panel_22, B=number_slider_14)  # disabled
pt_8 = PointOriented(BasePlane=pt_7, UComponent=0, VComponent=number_slider_23, WComponent=0)  # disabled
panel_24 = Panel("Field")  # disabled
rgb_4 = ColourRGB(Alpha=panel_23, Red=multiplication_9, Green=multiplication_9, Blue=multiplication_9)  # disabled
multiplication_10 = Multiplication(A=number_slider_4, B=number_slider_24)  # disabled
tag = TextTag3D(Location=pt_8, Text=panel_24, Size=multiplication_10, Colour=rgb_4, Justification=7)  # disabled

# ---- group: 長さ変化
crv_13 = Curve(crv_12)  # disabled
panel_25 = Panel("1")  # disabled
subtraction_7 = Subtraction(A=panel_25, B=number_slider_13)  # disabled
len_5 = Length(Curve=crv_13)  # disabled
multiplication_11 = Multiplication(A=len_5, B=subtraction_7)  # disabled
neg_5 = Negative(Value=multiplication_11)  # disabled
panel_26 = Panel("0")  # disabled
ext_5 = ExtendCurve(Curve=crv_13, Type=0, Start=panel_26, End=neg_5)  # disabled

crv_14 = Curve(crv_11)  # disabled
panel_27 = Panel("1")  # disabled
subtraction_8 = Subtraction(A=panel_27, B=number_slider_10)  # disabled
len_6 = Length(Curve=crv_14)  # disabled
multiplication_12 = Multiplication(A=len_6, B=subtraction_8)  # disabled
neg_6 = Negative(Value=multiplication_12)  # disabled
panel_28 = Panel("0")  # disabled
ext_6 = ExtendCurve(Curve=crv_14, Type=0, Start=panel_28, End=neg_6)  # disabled

# ---- group: 色変化
panel_29 = Panel("255")  # disabled
panel_30 = Panel("255")  # disabled
multiplication_13 = Multiplication(A=panel_30, B=number_slider_15)  # disabled
rgb_5 = ColourRGB(Alpha=panel_29, Red=multiplication_13, Green=multiplication_13, Blue=multiplication_13)  # disabled
preview_4 = CustomPreview(Geometry=ext_5, Material=rgb_5)  # disabled

panel_31 = Panel("255")  # disabled
panel_32 = Panel("255")  # disabled
multiplication_14 = Multiplication(A=panel_32, B=number_slider_12)  # disabled
rgb_6 = ColourRGB(Alpha=panel_31, Red=multiplication_14, Green=multiplication_14, Blue=multiplication_14)  # disabled
preview_5 = CustomPreview(Geometry=ext_6, Material=rgb_6)  # disabled

# ---- group: 長さ変化
explode_6 = Explode(Curve=crv_5, Recursive=True)  # -> Segments, Vertices
crv_15 = Curve(explode_6.Segments)
subtraction_9 = Subtraction(A="1", B=graph_6)
len_7 = Length(Curve=crv_15)
multiplication_15 = Multiplication(A=len_7, B=subtraction_9)
neg_7 = Negative(Value=multiplication_15)
ext_7 = ExtendCurve(Curve=crv_15, Type=0, Start="0", End=neg_7)

# ----
item_4 = ListItem(List=flatten(explode_6.Segments), Index=Slider(2, range=0..10), Wrap=True)
number_slider_25 = Slider(946, range=0..2000)
end_5 = EndPoints(Curve=item_4)  # -> Start, End
pt_9 = Point(end_5.Start)
pt_10 = PointOriented(BasePlane=pt_9, UComponent=number_slider_25, VComponent=number_slider_25, WComponent=0)
pt_11 = PointOriented(BasePlane=pt_10, UComponent=Slider(2000, range=0..2000), VComponent=0, WComponent=0)
merge_3 = Merge(Data1=pt_9, Data2=pt_10, Data3=pt_11)
pline_3 = PolyLine(Vertices=merge_3, Closed=False)

# ---- group: 色変化
multiplication_16 = Multiplication(A="255", B=graph_3)
rgb_7 = ColourRGB(Alpha="255", Red=multiplication_16, Green=multiplication_16, Blue=multiplication_16)
preview_6 = CustomPreview(Geometry=ext_7, Material=rgb_7)

# ---- group: 引き出し線
crv_16 = Curve(pline_3)

# ---- group: テキストサイズ・色
explode_7 = Explode(Curve=crv_16, Recursive=True)  # -> Segments, Vertices
item_5 = ListItem(List=explode_7.Segments, Index=0, Wrap=True)
end_6 = EndPoints(Curve=item_5)  # -> Start, End
pt_12 = Point(end_6.End)
multiplication_17 = Multiplication(A="255", B=graph_5)
pt_13 = PointOriented(BasePlane=pt_12, UComponent=0, VComponent=Slider(200, range=0..1000), WComponent=0)
rgb_8 = ColourRGB(Alpha="255", Red=multiplication_17, Green=multiplication_17, Blue=multiplication_17)
multiplication_18 = Multiplication(A=graph_2, B=Slider(589, range=0..1000))
tag_2 = TextTag3D(Location=pt_13, Text="Field", Size=multiplication_18, Colour=rgb_8, Justification=7)

# ---- group: 長さ変化
crv_17 = Curve(crv_16)
subtraction_10 = Subtraction(A="1", B=graph)
len_8 = Length(Curve=crv_17)
multiplication_19 = Multiplication(A=len_8, B=subtraction_10)
neg_8 = Negative(Value=multiplication_19)
ext_8 = ExtendCurve(Curve=crv_17, Type=0, Start="0", End=neg_8)

# ---- group: 色変化
multiplication_20 = Multiplication(A="255", B=graph_4)
rgb_9 = ColourRGB(Alpha="255", Red=multiplication_20, Green=multiplication_20, Blue=multiplication_20)
preview_7 = CustomPreview(Geometry=ext_8, Material=rgb_9)
